% Simulink data dictionary mecanum_params.sldd

Ra = Simulink.Parameter(3.75)
Kt = Simulink.Parameter(0.013)
Ke = Simulink.Parameter(0.013)
n = Simulink.Parameter(90)
Rw = Simulink.Parameter(0.04)
Ts = Simulink.Parameter(0.001)
Vmax = Simulink.Parameter(12)
mu_wheel = Simulink.Parameter(0.5)